# Grasshopper definition RP_2023_WS_Final_Assignment_Yang_Zonghai.gh (Grasshopper 1.0.7)
# plug-ins: KUKA|prc - parametric robot control

# ---- group: parameters for milling
safty_offset_mm = Slider(8, range=0..10)
step_over_rough_from_diameter = Slider(0.65, range=0..1)
step_over_fine_from_diameter = Slider(0.2, range=0..1)
speed_m_sec = Slider(0.025, range=0..0.1)
depth_z = Slider(36, range=0..100)
milling_depth_mm = Slider(5, range=0..10)
# Milling parameters
milling_diameter_mm = Slider(18, range=0..100)
multiplication = Multiplication(A=milling_diameter_mm, B=step_over_fine_from_diameter)
multiplication_2 = Multiplication(A=milling_diameter_mm, B=0.5)
multiplication_3 = Multiplication(A=milling_diameter_mm, B=step_over_rough_from_diameter)

# ----
# geo parameters
number_slider = Slider(13, range=0..50)

# ---- group: create surface
Z = UnitZ(Factor=expr("x", Slider(36, range=0..100)))
planesrf = PlaneSurface(Plane=PlaneXY(0, 0, 0), XSize=Slider(400, range=0..1000), YSize=Slider(400, range=0..1000))
move = Move(Geometry=planesrf, Motion=Z)  # -> Geometry, Transform
srf = Surface(move.Geometry)

# ---- group: create random patterns
popgeo = PopulateGeometry(Geometry=srf, Count=Slider(30, range=0..50), Seed=number_slider)
voronoi = Voronoi(Points=popgeo, Boundary=srf, BruteForceOverride=False)
# get Geo model
area = Area(Geometry=voronoi)  # -> Area, Centroid

# ---- group: intruduce curve interference
pt = Point(area.Centroid)
crv = Curve(<curve referenced from the Rhino model>)
pull = PullPoint(Point=pt, Geometry=crv, ClosestOnly=True)  # -> ClosestPoint, Distance
bnd = Bounds(Numbers=pull.Distance)
dom = ConstructDomain(DomainStart=Slider(0.7, range=0..1), DomainEnd=Slider(0.94, range=0..1))
remap = RemapNumbers(Value=pull.Distance, Source=bnd, Target=dom)  # -> Mapped, Clipped

# ---- group: extrude 36mm and get final model
scale = Scale(Geometry=voronoi, Center=area.Centroid, Factor=remap.Mapped)  # -> Geometry, Transform
crv_2 = Curve(flatten([scale.Geometry, srf]))
Z_2 = UnitZ(Factor=expr("-x", Slider(36, range=0..100)))
boundary = BoundarySurfaces(Edges=crv_2)
extr = Extrude(Base=boundary, Direction=Z_2)
geo = Geometry(extr)

# ----
# fine milling path
router_radius = Number(multiplication_2)
step_over_fine = Number(multiplication)
outer_crv_for_fine_milling = Curve(graft(scale.Geometry))
merge = Merge(Data1=router_radius, Data2=step_over_fine)
ma = MassAddition(Input=merge)  # -> Result, PartialResults
offset = OffsetCurve(Curve=outer_crv_for_fine_milling, Distance=expr("-x", router_radius), Corners=1)
milling_depth = Number(milling_depth_mm)
depth = Number(depth_z)
trim = TrimTree(Tree=offset, Depth=1)
division = Division(A=depth, B=milling_depth)
cp_outer_crv = ControlPoints(Curve=trim)  # -> Points, Weights, Knots
round = Round(Number=division)  # -> Nearest, Floor, Ceiling
trim_2 = TrimTree(Tree=cp_outer_crv.Points, Depth=1)
mod = Modulus(A=depth, B=milling_depth)
repeat = RepeatData(Data=milling_depth, Length=round.Ceiling)
pline = PolyLine(Vertices=reverse(trim_2), Closed=True)
replace = ReplaceItems(List=repeat, Item=mod, Indices=0, Wrap=False)
end = EndPoints(Curve=pline)  # -> Start, End
ma_2 = MassAddition(Input=replace)  # -> Result, PartialResults
Z_3 = UnitZ(Factor=expr("-x", ma_2.PartialResults))
start_point_for_big_crv = Point(end.Start)
move_2 = Move(Geometry=pline, Motion=Z_3)  # -> Geometry, Transform

panel = Panel(replace)

# ---- group: caculate big and small curve
center_pt = Point(simplify(graft(pt)))
offset_2 = OffsetCurve(Curve=outer_crv_for_fine_milling, Distance=expr("-x", ma.Result), Corners=1)
inside_crv_for_rough_milling = Curve(offset_2)
cp_inside_crv = ControlPoints(Curve=inside_crv_for_rough_milling)  # -> simplify(Points), Weights, Knots
dist = Distance(PointA=center_pt, PointB=cp_inside_crv.Points)  # -> flatten(Distance)
dist_2 = Distance(PointA=center_pt, PointB=cp_inside_crv.Points)  # -> flatten(Distance)
sort = SortList(Keys=dist_2, ValuesA=dist_2)  # -> Keys, ValuesA
sort_2 = SortList(Keys=dist, ValuesA=dist)  # -> Keys, ValuesA
subtraction = Subtraction(A=sort.ValuesA, B=18)
subtraction_2 = Subtraction(A=sort_2.ValuesA, B=27)

# ----
vec = VectorXYZ(XComponent=Slider(-70, range=-1000..1000), YComponent=Slider(0, range=-1000..1000), ZComponent=0)  # -> Vector, Length
merge_2 = Merge()

# ----
# 8 mm Tool configuration
blade_length_mm = Slider(42, range=40..100)
tool_length_mm = Slider(48, range=40..100)

# ----
# Simulation Slider
number_slider_2 = Slider(0.951903, range=0..1)

# ----
# save file
# Have you defined the output
# path in the core-component?
file_name = Panel("MMDD_V1_name")
press_to_save = Button()

# ---- group: rough path for big curve
merge_3 = Merge(
    Data1=Slider(0.15, range=0..1),
    Data2=Slider(0.3, range=0..1),
    Data3=Slider(0.3, range=0..1),
    Data4=Slider(0.3, range=0..1))
ma_3 = MassAddition(Input=merge_3)  # -> Result, PartialResults
milling_depth_2 = Number(milling_depth_mm)
depth_2 = Number(depth_z)
division_2 = Division(A=depth_2, B=milling_depth_2)
round_2 = Round(Number=division_2)  # -> Nearest, Floor, Ceiling
repeat_2 = RepeatData(Data=milling_depth_2, Length=round_2.Ceiling)
mod_2 = Modulus(A=depth_2, B=milling_depth_2)
replace_2 = ReplaceItems(List=repeat_2, Item=mod_2, Indices=0, Wrap=False)
ma_4 = MassAddition(Input=replace_2)  # -> Result, PartialResults
Z_4 = UnitZ(Factor=expr("-x", ma_4.PartialResults))

# ---- group: rough milling path for small curve
milling_depth_3 = Number(milling_depth_mm)
depth_3 = Number(depth_z)
division_3 = Division(A=depth_3, B=milling_depth_3)
round_3 = Round(Number=division_3)  # -> Nearest, Floor, Ceiling
repeat_3 = RepeatData(Data=milling_depth_3, Length=round_3.Ceiling)

# ----
# rough milling path
mod_3 = Modulus(A=depth_3, B=milling_depth_3)
replace_3 = ReplaceItems(List=repeat_3, Item=mod_3, Indices=0, Wrap=False)
panel_2 = Panel(replace_2)
panel_3 = Panel(replace_3)

item = ListItem(List=panel_2, Index=0, Wrap=True)

# ---- group: rough milling path for small curve (continued)
ma_5 = MassAddition(Input=replace_3)  # -> Result, PartialResults
Z_5 = UnitZ(Factor=expr("-x", ma_5.PartialResults))

# ----
# safty offset
depth_of_first_layer = Number(item)
safty_offset = Number(safty_offset_mm)
addition = Addition(A=safty_offset, B=depth_of_first_layer)
Z_6 = UnitZ(Factor=addition)

# ----
# The results shows that 2 or 3 times of milling is needed
# 28\(18*0.65) = 2.3
panel_4 = Panel(subtraction_2)
panel_5 = Panel(subtraction)

# ---- group: devide the bigger and smaller curves(no need for rough milling)
crv_3 = Curve(inside_crv_for_rough_milling)
area_2 = Area(Geometry=flatten(crv_3))  # -> Area, Centroid

# ----
param = Param(relay=crv_3)
panel_6 = Panel(param)

# ---- group: devide the bigger and smaller curves(no need for rough milling) (continued)
sort_3 = SortList(Keys=area_2.Area, ValuesA=param)  # -> Keys, ValuesA
split = SplitList(List=sort_3.ValuesA, Index=Slider(5, range=0..10))  # -> ListA, ListB

# ----
branch = TreeBranch(Tree=crv_3, Path=split.ListB, MaintainPaths=True)
branch_2 = TreeBranch(Tree=crv_3, Path=split.ListA, MaintainPaths=True)

# ---- group: devide the bigger and smaller curves(no need for rough milling) (continued)
small_crv = Curve(branch_2)
big_crv = Curve(branch)

# ---- group: rough milling path for small curve (continued)
crv_4 = Curve(small_crv)
area_3 = Area(Geometry=crv_4)  # -> Area, Centroid
scale_2 = Scale(Geometry=crv_4, Center=area_3.Centroid, Factor=Slider(0.5, range=0..1))  # -> Geometry, Transform
merge_4 = Merge(Data1=scale_2.Geometry, Data2=crv_4)
cp_outer_crv_2 = ControlPoints(Curve=merge_4)  # -> Points, Weights, Knots
trim_3 = TrimTree(Tree=cp_outer_crv_2.Points, Depth=1)
pline_2 = PolyLine(Vertices=trim_3, Closed=True)
end_2 = EndPoints(Curve=pline_2)  # -> Start, End
start_point_for_big_crv_2 = Point(end_2.Start)
move_3 = Move(Geometry=pline_2, Motion=Z_5)  # -> Geometry, Transform

# ---- group: rough path for big curve (continued)
crv_5 = Curve(big_crv)
area_4 = Area(Geometry=crv_5)  # -> Area, Centroid
scale_3 = Scale(Geometry=crv_5, Center=area_4.Centroid, Factor=ma_3.PartialResults)  # -> Geometry, Transform
merge_5 = Merge(Data1=scale_3.Geometry, Data2=crv_5)
cp_outer_crv_3 = ControlPoints(Curve=merge_5)  # -> Points, Weights, Knots
trim_4 = TrimTree(Tree=cp_outer_crv_3.Points, Depth=1)
pline_3 = PolyLine(Vertices=trim_4, Closed=True)
end_3 = EndPoints(Curve=pline_3)  # -> Start, End
start_point_for_big_crv_3 = Point(end_3.Start)
move_4 = Move(Geometry=pline_3, Motion=Z_4)  # -> Geometry, Transform

# ----
# Milling path
rough_milling_path = Geometry([move_4.Geometry, move_3.Geometry])
merge_6 = Merge(Data1=simplify(move_2.Geometry), Data2=simplify(rough_milling_path))

cp = ControlPoints(Curve=merge_6)  # -> Points, Weights, Knots
trim_5 = TrimTree(Tree=cp.Points, Depth=1)
item_2 = ListItem(List=trim_5, Index=0, Wrap=True)
move_5 = Move(Geometry=item_2, Motion=Z_6)  # -> Geometry, Transform
merge_7 = Merge(Data1=move_5.Geometry, Data2=trim_5, Data3=move_5.Geometry)
pline_4 = PolyLine(Vertices=merge_7, Closed=False)
end_4 = EndPoints(Curve=pline_4)  # -> Start, End
pt_2 = Point(end_4.Start)

pcen = PolygonCenter(Polyline=small_crv)  # -> CenterV, CenterE, CenterA
cp_2 = ControlPoints(Curve=small_crv)  # -> Points, Weights, Knots
# calculation part
dist_3 = Distance(PointA=pcen.CenterV, PointB=cp_2.Points)  # -> flatten(Distance)
sort_4 = SortList(Keys=dist_3, ValuesA=dist_3)  # -> Keys, ValuesA
subtraction_3 = Subtraction(A=sort_4.ValuesA, B=16)
panel_7 = Panel(subtraction_3)

xy = XYPlane(Origin=merge_7)

# ----
# select one pocket
panel_8 = Panel("{0}")
branch_3 = TreeBranch(Tree=xy, Path=panel_8, MaintainPaths=True)

move_6 = Move(Geometry=branch_3, Motion=vec.Vector)  # -> Geometry, Transform

# ----
# Implement robot cell
# Romulus
# Corner A
# Corner B
# Height of cell
panel_9 = Panel("550")
pt_3 = ConstructPoint(XCoordinate="1680", YCoordinate=panel_9, ZCoordinate=0)
pt_4 = ConstructPoint(XCoordinate="-440", YCoordinate="-830", ZCoordinate=0)
rec_2pt = Rectangle2Pt(Plane=PlaneXY(0, 0, 0), PointA=pt_4, PointB=pt_3, Radius=0)  # -> Rectangle, Length
Z_7 = UnitZ(Factor="1500")
extr_2 = Extrude(Base=rec_2pt.Rectangle, Direction=Z_7)
boundary_2 = BoundarySurfaces(Edges=rec_2pt.Rectangle)
debrep = DeconstructBrep(Brep=extr_2)  # -> Faces, Edges, Vertices
mesh_uv = MeshSurface(Surface=flatten([boundary_2, debrep.Faces]), UCount=5, VCount=5, Overhang=True, Equalize=False)
kr6_10_r1100_2 = AgilusKR610R11002Robot(infiniterot=False)

# ----
# Mesh
# Robot
# Cell
mjoin = MeshJoin(Meshes=mesh_uv)

robot_cell = RobotCellKUKAPrc(KUKAPrcRobotInput=kr6_10_r1100_2, CellGeometry=mjoin)

# ----
# Robot Control
lin_move = LINearMovementKUKAPrc(TargetAsPlane=xy, extaxenabled=False, interpolation="C_DIS")
tool_nr = Panel("2")
spindle_vacuum = KressSpindleVacuumAdapter20mmBrush()

# ----
# to robot
data = Data(flatten(lin_move))

# ----
# robot control
kress_spindle = Kress1050SpindleKUKAPrc(ToolLength=tool_length_mm, ToolDiameter=Slider(18, range=0..100), ToolNumber=tool_nr)
kuka_prc = KUKAPrcCORE(
    SimulationSlider=number_slider_2,
    KUKAPrcCommands=data,
    Tool=spindle_vacuum,
    Robot=robot_cell,
    SaveToggle=press_to_save,
    Filename=file_name,
    PRC_BaseExpose=False,
    PRC_SaveNameExpose=True,
    PRCsettings="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")  # -> RobotGeometry, AnalysisOutput

analysis = AnalysisKUKAPrc(KUKAPrcAnalysisData=kuka_prc.AnalysisOutput)  # -> RobotAxisValues, RobotCollisionCheck, RobotReachabilityCheck, CommandID, TimeValue, Planes, CommandTags, IOState, Index, KRL

# ----
# Est. time in sec
# Est. time in min
item_3 = ListItem(List=flatten(analysis.TimeValue), Index=0, Wrap=True)  # -> Item1, Item
panel_10 = Panel(item_3.Item1)
division_4 = Division(A=item_3.Item1, B=60)
panel_11 = Panel(division_4)

# ----
# Reach. issues
ma_6 = MassAddition(Input=flatten(analysis.RobotReachabilityCheck))  # -> Result, PartialResults
panel_12 = Panel(ma_6.Result)

# ----
# Collision issues
ma_7 = MassAddition(Input=flatten(analysis.RobotCollisionCheck))  # -> Result, PartialResults
panel_13 = Panel(ma_7.Result)

# ==== cluster Param
relay = ClusterInput()
viewer = ParamViewer(relay)
relay_2 = ClusterOutput(viewer)

# ==== cluster KressSpindleVacuumAdapter20mmBrush: Kress Spindle 1050 with custom mount and vacuum adapter. The brushes are longer than visualized, only the mostly stiff part is shown. State: 2024/01/16
custom_tool = CustomToolKUKAPrc(
    CustomToolGeometry=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,
    isExternal=False,
    toolid=2,
    toolvala=3.32,
    toolvalb=0.037,
    toolvalc=0.042,
    toolvalx=191.7,
    toolvaly=11.1,
    toolvalz=55.8,
    valuesset=True)
tool = ClusterOutput(custom_tool)
